# Grasshopper definition test.gh (Grasshopper 1.0.7)

panel = Panel("C:\Users\Administrator\master\git\deeprad\data\models\floorplan_1754\simulation\0_model.json")
panel_2 = Panel("C:\Users\Administrator\master\git\deeprad\data\models\floorplan_1754\simulation\test_load.hbjson")
geo = Geometry([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])
room2d = DFRoom2D(geo=flatten(geo), flr_to_ceiling="3", conditioned=Toggle(True))  # -> report, room2d; plug-in component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
loadobjects = HBLoadObjects(hb_file=panel_2, load=Toggle(True))  # -> report, hb_objs; plug-in component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
toggle = BooleanToggle(True)
introom2d = DFIntersectRoom2Ds(room2ds=flatten(room2d.room2d), run=toggle)  # -> int_room2ds; plug-in component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
solveadj2d = DFSolveAdjacency(room2ds=flatten(introom2d), run=toggle)  # -> report, adj_room2ds; plug-in component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
simpleratiopar = DFSimpleWindowRatioParameters(ratio="0.3")  # -> win_par; plug-in component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
applyfacadepar = DFApplyFacadeParameters(df_obj=flatten(solveadj2d.adj_room2ds), win_par=simpleratiopar)  # -> report, df_obj; plug-in component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
story = DFStory(room2ds=flatten(applyfacadepar.df_obj))  # -> report, story; plug-in component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
buildingstories = DFBuildingFromStories(stories=story.story)  # -> report, building; plug-in component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
model = DFModel(buildings=flatten(buildingstories.building))  # -> report, model; plug-in component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
tohoneybee = DFModelToHoneybee(model=model.model, run=Toggle(True))  # -> report, hb_models; plug-in component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
toggle_2 = BooleanToggle(True)
vizbytype = HBVisualizeByType(hb_objs=tohoneybee.hb_models)  # -> walls, interior_walls, roofs, ceilings, exterior_floors, interior_floors, air_walls, apertures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; plug-in component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
vizall = HBVizualizeAll(hb_objs=flatten(tohoneybee.hb_models))  # -> geo; plug-in component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
simoutput = HBSimulationOutput(zone_energy_use=toggle_2, gains_and_losses=toggle_2, surface_temperature=toggle_2, surface_energy_flow=toggle_2)  # -> report, sim_output; plug-in component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
simpar = HBSimulationParameter(output=simoutput.sim_output, timestep=6)  # -> sim_par; plug-in component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
panel_3 = Panel("https://www.energyplus.net/weather-download/north_and_central_america_wmo_region_4/USA/MA/USA_MA_Boston-Logan.Intl.AP.725090_TMY3/all")
toggle_3 = BooleanToggle(False)  # disabled
panel_4 = Panel("1.1.0")  # disabled
versioner = LBVersioner(update=toggle_3, version=panel_4)  # -> Vviiiiiz; disabled; plug-in component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
downloadepw = LBDownloadWeather(weather_URL=panel_3)  # -> epw_file, stat_file, ddy_file; plug-in component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
panel_5 = Panel(versioner)  # disabled
toggle_4 = BooleanToggle(True)
modeltoosm = HBModelToOSM(model=tohoneybee.hb_models, epw_file=downloadepw.epw_file, sim_par=simpar, write=toggle_4, run=toggle_4)  # -> report, jsons, osw, osm, idf, sql, zsz, rdd, html; plug-in component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
data = Data(tohoneybee.hb_models)
faceresult = HBReadFaceResult(sql=modeltoosm.sql)  # -> face_indoor_temp, face_outdoor_temp, face_energy_flow; plug-in component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
colorfaces = HBColorFaces(data=flatten(faceresult.face_outdoor_temp), hb_objs=flatten(data))  # -> report, mesh, wire_frame, legend, title, faces, colors, values; plug-in component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
panel_6 = Panel(colorfaces.faces)
# Face: Room_f328deae..Face0
# Face: Room_f328deae..Face1
# Face: Room_f328deae..Face2
# Face: Room_f328deae..Face3
# Face: Room_f328deae..Face4
# Aperture: Room_f328deae..Face4_Glz1
# Face: Room_f328deae..Face5
# Face: Room_e2080b13..Face0
# Face: Room_e2080b13..Face1
# Aperture: Room_e2080b13..Face1_Glz1
# Face: Room_e2080b13..Face2
# Face: Room_e2080b13..Face3
# Face: Room_e2080b13..Face4
# Aperture: Room_e2080b13..Face4_Glz1
# Face: Room_e2080b13..Face5
# Face: Room_c783063d..Face0
# Face: Room_c783063d..Face1
# Face: Room_c783063d..Face2
# Face: Room_c783063d..Face3
# Aperture: Room_c783063d..Face3_Glz1
# Face: Room_c783063d..Face4
# Aperture: Room_c783063d..Face4_Glz1
# Face: Room_c783063d..Face5
# Aperture: Room_c783063d..Face5_Glz1
# Face: Room_c783063d..Face6
# Face: Room_60985854..Face0
# Face: Room_60985854..Face1
# Aperture: Room_60985854..Face1_Glz1
# Face: Room_60985854..Face2
# Aperture: Room_60985854..Face2_Glz1
# Face: Room_60985854..Face3
# Face: Room_60985854..Face4
# Face: Room_60985854..Face5
# Face: Room_60985854..Face6
panel_7 = Panel("""23.298405
23.249081
23.288132
22.329459
14.683178
12.834507
22.843777
24.587058
16.773593
13.659874
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""")
