# Grasshopper definition _bem_simulate_1.gh (Grasshopper 1.0.7)
# plug-ins: Heteroptera, Human, horsterCameraControl, Ironbug.LBHB_Legacy

toggle = BooleanToggle(True)  # disabled
vec = VectorXYZ(XComponent=0, YComponent=0, ZComponent=0)  # -> Vector, Length
camera = CameraCrane(Refresh=True)  # -> Camera, Target, Lens, Up, HorizontalViewAngle, VerticalViewAngle, ScreenRatio, Frame
toggle_2 = BooleanToggle(True)  # disabled
panel = Panel("1.1.0")  # disabled
getcamera = GetCamera(GetCamera=toggle)  # -> Location, Target, LensLength, UpDirection; disabled
circle = CircleCNR(Center=vec.Vector, Normal=Vector(0, 0, 1), Radius="100")
cam_story = CameraStory(Control=0, frames=[[], [], [], [], [], [], [], [], [], []])
animcamera = AnimateCamera(SaveCameraState=Toggle(False), Reset=Toggle(False))
versioner = LBVersioner(update=toggle_2, version=panel)  # -> Vviiiiiz; disabled; plug-in component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
number_slider = Slider(3, range=1..4)
path = FilePath("C:\Users\Administrator\master\git\deeprad\data\models\")
panel_2 = Panel(getcamera.Location)  # disabled
panel_3 = Panel(getcamera.LensLength)  # disabled
python = GhPythonScript(model_num=Slider(5, range=0..9), models_dir=path, run=Toggle(True))  # -> polys, id, sim_dir; inputs model_num: Int32
# ---------- python: Python ----------
import os 
import json 
#import rhinoscriptsyntax as rs
import Rhino as rc

DEEPRAD_DATA_DIR = _models_dir

def extract_floorplan_ids(data_num):
    """Safely extract root model directories for polygon extraction."""

    # Load all model directories
    floorplan_id_arr = os.listdir(DEEPRAD_DATA_DIR)
    n_ids = len(floorplan_id_arr)
    
    if data_num > n_ids:
        print('Note: data_num {} is too high. Resetting to n_ids {}.'.format(
            data_num, n_ids))
        data_num = n_ids
    
    return data_num, floorplan_id_arr

def to_poly_rh(poly_xy):
    pts = [(round(x, 5), round(y, 5), 0) for x,y in zip(*poly_xy)]
    pts = [rc.Geometry.Point3d(*pt) for pt in pts]
    pts = pts + [pts[0]]
    return rc.Geometry.Polyline(pts)

def load_json(json_fpath):
    with open(json_fpath, 'r') as fp:
        val_dict = json.load(fp)
    return val_dict

#def get_model(_model_num):
#    _model_num = int(_model_num)
#    _model_num, model_ids = extract_floorplan_ids(_model_num)
#    model_id = model_ids[_model_num]
#    return model_id 
    
if run:
    
    null_fpath = os.path.join(DEEPRAD_DATA_DIR, '_null.txt')
    with open(null_fpath, 'r') as fp:
        null_lst = fp.readlines()
    model_id_lst = [n.replace('\n', '') for n in null_lst]
    
    model_id = model_id_lst[_model_num]
     
    model_id_dir = os.path.join(
        DEEPRAD_DATA_DIR, model_id, 'data')
    polygon_json_fpath = os.path.join(model_id_dir, 'polygon.json')

    polygons = load_json(polygon_json_fpath)
    polygons = polygons['polygons']
    
    polys = [to_poly_rh(polygon) for polygon in polygons]
    id = model_id
    sim_dir = model_id_dir + '_sim'
# ---------- end python ----------
panel_4 = Panel(versioner)  # disabled
toggle_3 = BooleanToggle(True)
division = Division(A=number_slider, B="4")
geo = Geometry([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])
boundary = BoundarySurfaces(Edges=graft(python.polys))  # -> flatten(Surfaces)
eval = EvaluateCurve(Curve=reparameterize(circle), Parameter=division)  # -> Point, Tangent, Length
simoutput = HBSimulationOutput(zone_energy_use=toggle_3, gains_and_losses=toggle_3, surface_energy_flow=toggle_3)  # -> report, sim_output; plug-in component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
item = ListItem(List=geo, Index=Slider(2, range=0..3), Wrap=True)
panel_5 = Panel("https://www.energyplus.net/weather-download/north_and_central_america_wmo_region_4/USA/MA/USA_MA_Boston-Logan.Intl.AP.725090_TMY3/all")
panel_6 = Panel(eval.Point)
pdecon = Deconstruct(Point=eval.Point)  # -> XComponent, YComponent, ZComponent
room2d = DFRoom2D(geo=flatten(boundary), flr_to_ceiling="2.5", conditioned=Toggle(True))  # -> report, room2d; plug-in component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
toggle_4 = BooleanToggle(True)
vec_2 = VectorXYZ(XComponent=pdecon.XComponent, YComponent=pdecon.YComponent, ZComponent="2")  # -> Vector, Length
panel_7 = Panel(python.sim_dir)
simpleratiopar = DFSimpleWindowRatioParameters(ratio="0.3")  # -> win_par; plug-in component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
downloadepw = LBDownloadWeather(weather_URL=panel_5)  # -> epw_file, stat_file, ddy_file; plug-in component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
analysisperiod = LBAnalysisPeriod(start_month="1", start_day=1, start_hour=0, end_month="1")  # -> period, hoys, dates; plug-in component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
panel_8 = Panel(python.id)
introom2d = DFIntersectRoom2Ds(room2ds=flatten(room2d.room2d), run=toggle_4)  # -> int_room2ds; plug-in component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
solveadj2d = DFSolveAdjacency(room2ds=flatten(introom2d), run=toggle_4)  # -> report, adj_room2ds; plug-in component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
applyfacadepar = DFApplyFacadeParameters(df_obj=flatten(solveadj2d.adj_room2ds), win_par=simpleratiopar)  # -> report, df_obj; plug-in component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
viewports = ViewportProperties(Update=True, AutoUpdate=False)  # -> ViewportNames, ActiveViewportIndex, ViewportBounds, ViewportDisplayMode, CameraLocation, CameraTarget, CameraPlane, CameraLensLength, CameraProjection, CameraUp
toggle_5 = BooleanToggle(False)
path_2 = FilePath("C:\Users\Administrator\master\git\deeprad\data\models\")
story = DFStory(room2ds=flatten(applyfacadepar.df_obj))  # -> report, story; plug-in component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
buildingstories = DFBuildingFromStories(stories=story.story)  # -> report, building; plug-in component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
python_2 = GhPythonScript(model_dir=path_2, view=number_slider, run=toggle_5)  # -> img_fpath
# ---------- python_2: Python ----------
import os 

if run:
    view = str(_view).replace('.', '_')
    img_fpath = \
    os.path.join(
        _model_dir, '..', 'img_test', 'img_{}.jpg'.format(view))
# ---------- end python_2 ----------
model = DFModel(buildings=flatten(buildingstories.building), name=panel_8)  # -> report, model; plug-in component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
vizall = DFVizualizeAll(df_objs=flatten(model.model))  # -> geo; plug-in component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
wires = BrepWireframe(Brep=vizall, Density=-1)
preview = CustomPreview(Geometry=wires, Material=ColourSwatch(SwatchColor=RGB(255, 255, 255)))
saveview = SaveViewportToFile(Run=toggle_5, Render=False, FilePath=python_2, ScaleFactor=1)
tohoneybee = DFModelToHoneybee(model=model.model, run=Toggle(True))  # -> report, hb_models; plug-in component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
panel_9 = Panel("Surface Outside Face Solar Radiation Heat Gain Energy")
data = Data(panel_9)
customoutput = HBCustomSimulationOutput(base_sim_output=simoutput.sim_output, output_names=data)  # -> report, sim_output; plug-in component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
panel_10 = Panel(data)
simpar = HBSimulationParameter(output=customoutput.sim_output, run_period=analysisperiod.period, timestep=6)  # -> sim_par; plug-in component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
panel_11 = Panel(saveview)
modeltoosm = HBModelToOSM(model=tohoneybee.hb_models, epw_file=downloadepw.epw_file, sim_par=simpar, folder=panel_7, write=Toggle(False), run="3")  # -> report, jsons, osw, osm, idf, sql, zsz, rdd, html; plug-in component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
panel_12 = Panel("Solar Surface")  # disabled
customresult = HBReadCustomResult(sql=modeltoosm.sql, output_names=panel_9)  # -> results; plug-in component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
readrdd = HBReadResultDictionary(rdd=modeltoosm.rdd, keywords=panel_12)  # -> outputs; disabled; plug-in component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
panel_13 = Panel("https://www.energyplus.net/weather-download/north_and_central_america_wmo_region_4/USA/MA/USA_MA_Boston-Logan.Intl.AP.725090_TMY3/all")
vizbytype = HBVisualizeByType(hb_objs=tohoneybee.hb_models)  # -> walls, interior_walls, roofs, ceilings, exterior_floors, interior_floors, air_walls, apertures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; plug-in component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
vizall_2 = HBVizualizeAll(hb_objs=flatten(tohoneybee.hb_models))  # -> geo; plug-in component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
bbox = BoundingBox(Content=vizall_2, Plane=PlaneXY(0, 0, 0))  # -> Box, Box_2
area = Area(Geometry=bbox.Box)  # -> Area, Centroid
ma = MassAddition(Input=area.Centroid)  # -> Result, PartialResults
lng = ListLength(List=area.Centroid)
devec = DeconstructVector(Vector=ma.Result)  # -> XComponent, YComponent, ZComponent
division_2 = Division(A=devec.XComponent, B=lng)
division_3 = Division(A=devec.YComponent, B=lng)
pt = ConstructPoint(XCoordinate=division_2, YCoordinate=division_3, ZCoordinate=0)
setcam = SetCamera(CameraLocation=vec_2.Vector, TargetLocation=pt, Activate=Toggle(True))
vizbybc = HBVizualizeByBC(hb_objs=tohoneybee.hb_models)  # -> outdoors, surface, ground, adiabatic, other, wire_frame; plug-in component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
data_2 = Data(tohoneybee.hb_models)
panel_14 = Panel(modeltoosm.sql)
imageviewer = Ladybug_ImageViewer(ImagePath_=panel_11, _scale_=1, DisableClickable=False, SaveImgWithCoords=False, scale=1)  # -> ImagePath, Values, GIF
panel_15 = Panel(readrdd)  # disabled
colorfaces = HBColorFaces(data=flatten(customresult), hb_objs=flatten(data_2))  # -> report, mesh, wire_frame, legend, title, faces, colors, values; plug-in component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
geo_2 = Geometry(vizbybc.surface)
downloadepw_2 = LBDownloadWeather(weather_URL=panel_13)  # -> epw_file, stat_file, ddy_file; plug-in component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
importepw = LBImportEPW(epw_file=downloadepw_2.epw_file)  # -> location, dry_bulb_temperature, dew_point_temperature, relative_humidity, wind_speed, wind_direction, direct_normal_rad, diffuse_horizontal_rad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; plug-in component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
toggle_6 = BooleanToggle(True)  # disabled
path_3 = FilePath("C:\Users\Administrator\master\git\deeprad\data\models\")  # disabled
python_3 = GhPythonScript(model_id=panel_8, models_dir=path_3, faces=colorfaces.faces, values=colorfaces.values, run=toggle_6)  # -> result; inputs faces: list, values: list; disabled
# ---------- python_3: Python ----------
import os 
import json 

def write_json(val_dict, dest_fpath):
    """Writes hdict to json."""
    with open(dest_fpath, 'w') as fp:
        json.dump(val_dict, fp, indent=4)
        
# Dump face/val as json
DEEPRAD_DATA_DIR = _models_dir 

if run:
    sim_id_dir = \
        os.path.join(DEEPRAD_DATA_DIR, _model_id, 'data_sim')
    label_json_fpath = \
        os.path.join(sim_id_dir, 'label_sim.json')
    
    val_dict = {
        'face_ids': [f.identifier for f in _faces],
        'values': _values
    }
    
    write_json(val_dict, label_json_fpath)
    result = label_json_fpath
# ---------- end python_3 ----------
skymatrix = LBCumulativeSkyMatrix(location=importepw.location, direct_rad=importepw.direct_normal_rad, diffuse_rad=importepw.diffuse_horizontal_rad)  # -> report, sky_mtx; plug-in component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
panel_16 = Panel(python_3)  # disabled
incidentradiation = LBIncidentRadiation(sky_mtx=skymatrix.sky_mtx, geometry=flatten(vizall_2), grid_size="1", run=Toggle(True))  # -> report, points, results, total, mesh, legend, title, int_mtx; plug-in component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
