# Grasshopper definition _bem_train_1.gh (Grasshopper 1.0.7)

# ----
# Path to:
# ...\deeprad\data\models\
path = FilePath("C:\Users\Administrator\master\git\deeprad\data\models\")

python = GhPythonScript(models_dir=path, model_num=Slider(9, range=0..9), run=Toggle(True))  # -> face_ids, values, hbjson
# ---------- python: Python ----------
import os 
import json 

# Dump face/val as json
DEEPRAD_DATA_DIR = _models_dir 

def load_json(json_fpath):
    with open(json_fpath, 'r') as fp:
        val_dict = json.load(fp)
    return val_dict
    
def extract_floorplan_ids(data_num):
    """Safely extract root model directories for polygon extraction."""

    # Load all model directories
    floorplan_id_arr = os.listdir(DEEPRAD_DATA_DIR)
    n_ids = len(floorplan_id_arr)

    if data_num > n_ids:
        print('Note: data_num {} is too high. Resetting to n_ids {}.'.format(
            data_num, n_ids))
        data_num = n_ids

    return data_num, floorplan_id_arr
    
if run:
    _model_num = int(_model_num)
    _model_num, model_ids = extract_floorplan_ids(_model_num)
    model_id = model_ids[_model_num]
    
    sim_id_dir = \
        os.path.join(DEEPRAD_DATA_DIR, model_id, 'data_sim')
    
    # Get model_hbjson
    hbjson_id = [d for d in os.listdir(sim_id_dir) 
                     if 'Building' in d][0]
    hbjson_fpath = os.path.join(
        sim_id_dir, hbjson_id, 'OpenStudio', 
        '{}.hbjson'.format(hbjson_id))
    
    # Get value json 
    val_json_fpath = os.path.join(sim_id_dir, 'label_sim.json')
    vals = load_json(val_json_fpath)
    
    # outputs
    face_ids = vals['face_ids']
    values = vals['values']
    hbjson = hbjson_fpath
# ---------- end python ----------
panel = Panel(python.face_ids)
panel_2 = Panel(python.values)
loadobjects = HBLoadObjects(hb_file=python.hbjson, load=Toggle(True))  # -> report, hb_objs; plug-in component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
python_2 = GhPythonScript(x=python.values)  # -> min, max, t; inputs x: list
# ---------- python_2: Python ----------
_x = sorted(x)
min_, max_ = _x[0], _x[-1]
t = x
# ---------- end python_2 ----------
python_3 = GhPythonScript(face_ids=python.face_ids, hb_objs=loadobjects.hb_objs)  # -> walls, apertures, wire_frame; inputs face_ids: list, hb_objs: list
# ---------- python_3: Python ----------
try:  # import the ladybug dependencies
    from ladybug.color import Colorset
except ImportError as e:
    raise ImportError('\nFailed to import ladybug:\n\t{}'.format(e))

try:  # import the core honeybee dependencies
    from honeybee.model import Model
    from honeybee.room import Room
    from honeybee.face import Face
    from honeybee.aperture import Aperture
    from honeybee.door import Door
    from honeybee.shade import Shade
    from honeybee.boundarycondition import Surface
    from honeybee.facetype import Wall, RoofCeiling, Floor, AirBoundary
except ImportError as e:
    raise ImportError('\nFailed to import honeybee:\n\t{}'.format(e))

try:  # import the ladybug_rhino dependencies
    from ladybug_rhino.config import tolerance
    from ladybug_rhino.fromgeometry import from_face3ds_to_colored_mesh, \
        from_face3d_to_wireframe, from_face3d
    from ladybug_rhino.grasshopper import all_required_inputs
except ImportError as e:
    raise ImportError('\nFailed to import ladybug_rhino:\n\t{}'.format(e))

try:  # import the honeybee-energy extension
    from honeybee.boundarycondition import Adiabatic
except ImportError:  # honeybee-energy not installed
    Adiabatic = None  # don't worry about Aidabatic; Surface is the only interior bc

def add_aperture(ap):
    """Add an aperture to the relevant lists."""
    if isinstance(ap.boundary_condition, Surface):
        _interior_apertures.append(ap.geometry)
    else:
        _apertures.append(ap.geometry)

def add_face(face):
    """Add a Face to the relevant lists."""
    bc = face.boundary_condition
    type = face.type
    if isinstance(type, Wall):
        #if isinstance(bc, (Surface, Adiabatic)):
        #    _interior_walls.append(face.punched_geometry)
        _wall_names.append(face.identifier)
        _walls.append(face.punched_geometry)
    
    # add the apertures
    for ap in face.apertures:
       add_aperture(ap)
    
    return _walls

def add_room(room):
    """Add a Room to the relevant lists."""
    for face in room:
        add_face(face)


if all_required_inputs(ghenv.Component):
    # lists of rhino geometry to be filled with content
    _walls = []
    _wall_names = []
    _apertures = []
    
    # loop through the objects and group them by type
    for hb_obj in _hb_objs:
        if isinstance(hb_obj, Model):
            [add_room(room) for room in hb_obj.rooms]
        elif isinstance(hb_obj, Face):
            add_face(hb_obj)
        elif isinstance(hb_obj, Aperture):
            add_aperture(hb_obj)
            
    # color all of the geometry with its respective surface type
    palette = Colorset.openstudio_palette()
    apertures = from_face3ds_to_colored_mesh(_apertures, palette[9]) \
        if len(_apertures) != 0 else None
        
    # isolate analysis walls
    filter_walls = []
    for id in face_ids:
        for i, wall_name in enumerate(_wall_names):
            if wall_name == id:
                filter_walls.append(_walls[i])
                break
    
    # Get geometry
    _walls = filter_walls 
    walls = [from_face3d(w) for w in _walls]
    
    
    # wireframe
    all_geo = _walls + _apertures
    wire_frame = [from_face3d_to_wireframe(face) for face in all_geo]
# ---------- end python_3 ----------
vizbytype = HBVisualizeByType(hb_objs=loadobjects.hb_objs)  # -> walls, interior_walls, roofs, ceilings, exterior_floors, interior_floors, air_walls, apertures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; plug-in component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
gradient = Gradient(
    LowerLimit=python_2.min,
    UpperLimit=python_2.max,
    Parameter=python_2.t,
    stops=[0: RGB(234, 38, 0), 0.25: RGB(234, 126, 0), 0.5: RGB(254, 244, 84), 0.75: RGB(173, 203, 249), 1: RGB(75, 107, 169)])
geo = Geometry([python_3.wire_frame, python_3.apertures])
preview = CustomPreview(Geometry=python_3.walls, Material=gradient)
