# Grasshopper definition bem_model_serialize.gh (Grasshopper 1.0.7)

# ----
# Step 1:
# Set file path to Models dir
# ..\data\models\
path = FilePath("C:\Users\saeran2\master\git\deeprad\data\models\")

number_slider = Slider(10, range=0..10)
python = GhPythonScript(model_num=Slider(7, range=0..4999), models_dir=path, run=Toggle(True))  # -> polys, model_id, ghout_id_dir, sim_dir; inputs model_num: Int32
# ---------- python: Python ----------
import os 
import json 
#import rhinoscriptsyntax as rs
import Rhino as rc

# Path to all models in deep_rad
DEEPRAD_MODELS_DIR = _models_dir
DEEPRAD_GHOUT_DIR = os.path.join(
        DEEPRAD_MODELS_DIR, '..', 'ghout')
  
def extract_floorplan_ids(data_num):
    """Safely extract root model directories for polygon extraction."""

    # Load all model directories
    floorplan_id_arr = os.listdir(DEEPRAD_MODDELS_DIR)
    n_ids = len(floorplan_id_arr)
    
    if data_num > n_ids:
        print('Note: data_num {} is too high. Resetting to n_ids {}.'.format(
            data_num, n_ids))
        data_num = n_ids
    
    return data_num, floorplan_id_arr

def to_poly_rh(poly_xy):
    pts = [(round(x, 5), round(y, 5), 0) for x,y in zip(*poly_xy)]
    pts = [rc.Geometry.Point3d(*pt) for pt in pts]
    pts = pts + [pts[0]]
    return rc.Geometry.Polyline(pts)

def load_json(json_fpath):
    with open(json_fpath, 'r') as fp:
        val_dict = json.load(fp)
    return val_dict

#def get_model(_model_num):
#    _model_num = int(_model_num)
#    _model_num, model_ids = extract_floorplan_ids(_model_num)
#    model_id = model_ids[_model_num]
#    return model_id 
    
if run:
    
    #null_fpath = os.path.join(DEEPRAD_MODELS_DIR, '_null.txt')
    #with open(null_fpath, 'r') as fp:
    #    null_lst = fp.readlines()
    #null_lst = sorted(null_lst)
    #model_id_lst = [n.replace('\n', '') for n in null_lst]
    
    model_id_lst = sorted(os.listdir(DEEPRAD_MODELS_DIR))[1:]
    model_id_lst.sort(key=lambda ss: int(ss.split('_')[-1]))
    model_id = model_id_lst[_model_num]
    
    # Polygon json
    model_id_dir = os.path.join(
        DEEPRAD_MODELS_DIR, model_id)
    polygon_json_fpath = os.path.join(model_id_dir, 'data', 'polygon.json')

    polygons = load_json(polygon_json_fpath)
    polygons = polygons['polygons']
    
    polys = [to_poly_rh(polygon) for polygon in polygons]
    sim_dir = os.path.join(DEEPRAD_MODELS_DIR, '..', 'hbjsons', '{}_hb'.format(_model_num))
    sim_dir = os.path.abspath(sim_dir)
    
    ghout_id_dir = os.path.join(DEEPRAD_GHOUT_DIR, model_id)
    ghout_id_dir = os.path.abspath(ghout_id_dir)
# ---------- end python ----------
data = Data(python.polys)
runion = RegionUnion(Curves=data)
filter_by_area = FilterByArea(geom=runion)
rad = Radians(Degrees="70")
simplify = SimplifyCurve(Curve=filter_by_area, Tolerance="0.5", AngleTolerance=rad)  # -> Curve, Simplified
reb = RebuildCurve(Curve=simplify.Curve, Degree="0", Count="6", Tangents=False)
python_2 = GhPythonScript(x=simplify.Curve)  # -> a; inputs x: list
# ---------- python_2: Python ----------
import Rhino.Geometry as rhgeom 
import rhinoscriptsyntax as rs
import scriptcontext as sc

geoms = []
for _x in x:
    try:
        geom = rs.coercecurve(_x).ToNurbsCurve()
        is_valid = 3 < len(geom.Points) < 10
        is_valid = is_valid and geom.IsClosed and geom.IsValid
        if not is_valid:
            continue
        geoms.append(geom)
    except:
        pass
        
if len(geoms) == 0:
    a = False
else:
    a = geoms
# ---------- end python_2 ----------
panel = Panel(python.sim_dir)
python_3 = GhPythonScript(x=reb, y=python_2)  # -> a; inputs x: list
# ---------- python_3: Python ----------
a = x if not y else y
# ---------- end python_3 ----------
filter_by_area_2 = FilterByArea(geom=python_3)
data_2 = Data(filter_by_area_2)

# ----
# Center geoms
boundary = BoundarySurfaces(Edges=data_2)
bbox = BoundingBox(Content=boundary, Plane=PlaneXY(0, 0, 0), UnionBox=True)  # -> Box, Box_2
area = Area(Geometry=bbox.Box)  # -> Area, Centroid

# ----
# Multiply by 3 floors
panel_2 = Panel("""0
2.5""")
neg = Negative(Value=area.Centroid)
Z = UnitZ(Factor=panel_2)
move = Move(Geometry=data_2, Motion=neg)  # -> Geometry, Transform
dup = DuplicateData(Data=graft(move.Geometry), Number="2", Order=True)  # -> simplify(Data)
flip = FlipMatrix(Data=dup)
move_2 = Move(Geometry=flip, Motion=graft(Z))  # -> Geometry, Transform
bang = ExplodeTree(Data=simplify(move_2.Geometry))  # -> Branch0, Branch1

boundary_2 = BoundarySurfaces(Edges=graft(bang.Branch0))  # -> flatten(Surfaces)
boundary_3 = BoundarySurfaces(Edges=graft(bang.Branch1))  # -> flatten(Surfaces)
room2d = DFRoom2D(geo=flatten(boundary_2), flr_to_ceiling="2.5", conditioned=Toggle(True))  # -> report, room2d; plug-in component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
room2d_2 = DFRoom2D(geo=flatten(boundary_3), flr_to_ceiling="2.5", conditioned=Toggle(True))  # -> report, room2d; plug-in component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
toggle = BooleanToggle(True)
toggle_2 = BooleanToggle(True)
panel_3 = Panel("https://www.energyplus.net/weather-download/north_and_central_america_wmo_region_4/USA/MA/USA_MA_Boston-Logan.Intl.AP.725090_TMY3/all")
introom2d = DFIntersectRoom2Ds(room2ds=flatten(room2d.room2d), run=toggle)  # -> int_room2ds; plug-in component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
solveadj2d = DFSolveAdjacency(room2ds=flatten(introom2d), run=toggle)  # -> report, adj_room2ds; plug-in component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
introom2d_2 = DFIntersectRoom2Ds(room2ds=flatten(room2d_2.room2d), run=toggle_2)  # -> int_room2ds; plug-in component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
solveadj2d_2 = DFSolveAdjacency(room2ds=flatten(introom2d_2), run=toggle_2)  # -> report, adj_room2ds; plug-in component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
panel_4 = Panel(python.model_id)
panel_5 = Panel(python.sim_dir)
downloadepw = LBDownloadWeather(weather_URL=panel_3)  # -> epw_file, stat_file, ddy_file; plug-in component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
story = DFStory(room2ds=flatten(solveadj2d.adj_room2ds))  # -> report, story; plug-in component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
story_2 = DFStory(room2ds=flatten(solveadj2d_2.adj_room2ds))  # -> report, story; plug-in component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
toggle_3 = BooleanToggle(True)
simoutput = HBSimulationOutput(zone_energy_use=toggle_3, gains_and_losses=toggle_3, surface_energy_flow=toggle_3, report_frequency="Daily")  # -> report, sim_output; plug-in component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
buildingstories = DFBuildingFromStories(stories=[story.story, story_2.story])  # -> report, building; plug-in component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
model = DFModel(buildings=flatten(buildingstories.building), name=panel_4)  # -> report, model; plug-in component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
customoutput = HBCustomSimulationOutput(base_sim_output=simoutput.sim_output)  # -> report, sim_output; plug-in component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
analysisperiod = LBAnalysisPeriod(start_month="1", start_day=1, start_hour=0, end_month="1")  # -> period, hoys, dates; plug-in component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
tohoneybee = DFModelToHoneybee(model=model.model, run=Toggle(True))  # -> report, hb_models; plug-in component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
simpar = HBSimulationParameter(output=customoutput.sim_output, run_period=analysisperiod.period, timestep="2")  # -> sim_par; plug-in component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
deconstructmodel = HBDeconstructModel(model=tohoneybee.hb_models)  # -> rooms, faces, apertures, doors, shades; plug-in component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
facparam = HBFacadeParameters(north="0.1", east=0, south="0.2", west=0)  # -> fac_par; plug-in component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
solveadj = HBSolveAdjacency(rooms=flatten(deconstructmodel.rooms), run=Toggle(True))  # -> report, adj_rooms; plug-in component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
and = GateAnd(A=Toggle(False), B=Toggle(True))
aperturesbyratio = HBAperturesByRatio(hb_objs=flatten(solveadj.adj_rooms), ratio=facparam, subdivide=Toggle(False))  # -> report, hb_objs; plug-in component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
model_2 = HBModel(rooms=flatten(aperturesbyratio.hb_objs), name=panel_4)  # -> report, model; plug-in component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
modeltoosm = HBModelToOSM(model=model_2.model, epw_file=downloadepw.epw_file, sim_par=simpar, folder=panel_5, write=and, run=and)  # -> report, jsons, osw, osm, idf, sql, zsz, rdd, html; plug-in component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
readrdd = HBReadResultDictionary(rdd=modeltoosm.rdd, keywords="incident")  # -> outputs; plug-in component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
panel_6 = Panel(modeltoosm.sql)
# Surface Outside Face Incident Solar Radiatiion per Area
panel_7 = Panel(readrdd)
vizwiref = HBVizualizeWireframe(hb_objs=flatten(aperturesbyratio.hb_objs))  # -> geo; plug-in component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
vizbytype = HBVisualizeByType(hb_objs=aperturesbyratio.hb_objs)  # -> walls, interior_walls, roofs, ceilings, exterior_floors, interior_floors, air_walls, apertures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; disabled; plug-in component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
vizbybc = HBVizualizeByBC(hb_objs=aperturesbyratio.hb_objs)  # -> outdoors, surface, ground, adiabatic, other, wire_frame; plug-in component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
mjoin = MeshJoin(Meshes=[vizbytype.walls, vizbytype.apertures])  # disabled
geo = Geometry(vizbybc.adiabatic)
facen = FaceNormals(Mesh=vizbytype.apertures)  # -> Centers, Normals; disabled
panel_8 = Panel("0.006")  # disabled
facen_2 = FaceNormals(Mesh=mjoin)  # -> Centers, Normals; disabled
multiplication = Multiplication(A=facen.Normals, B=panel_8)  # disabled
data_3 = Data()  # disabled
move_3 = Move(Geometry=vizbytype.apertures, Motion=multiplication)  # -> Geometry, Transform; disabled
swatch = ColourSwatch(SwatchColor=RGB(0, 0, 0))  # disabled
python_4 = GhPythonScript(depth_vec=facen_2.Centers, orient=data_3)  # -> depth_val; inputs depth_vec: list; disabled
# ---------- python_4: Python ----------
import rhinoscriptsyntax as rs

depth_vec = [rs.coerce3dpoint(xx) for xx in depth_vec]

if orient == 'north' or orient == 'south': 
    depth_axis = 1  # y-axis
else:
    depth_axis = 0  # x-axis

depth_val = [xx[depth_axis] for xx in depth_vec]
# ---------- end python_4 ----------
medges = MeshEdges(Mesh=move_3.Geometry)  # -> NakedEdges, InteriorEdges, NonManifoldEdges; disabled
preview = CustomPreview(Geometry=[vizbytype.wire_frame, medges.NakedEdges, medges.InteriorEdges, medges.NonManifoldEdges], Material=swatch)  # disabled

# ==== cluster FilterByArea
geom = ClusterInput()
geom_2 = Data(geom)
area = Area(Geometry=geom_2)  # -> Area, Centroid
larger = LargerThan(FirstNumber=area.Area, SecondNumber="4")  # -> LargerThan, OrEqualTo
python = GhPythonScript(x=geom_2, mask=larger.LargerThan)  # -> a; inputs x: list, mask: list
# ---------- python: Python ----------
a = [_x for _x, m in zip(x, mask) if m is True]
# ---------- end python ----------
a = ClusterOutput(python)
