# Grasshopper definition floorplan_sim_1.gh (Grasshopper 1.0.7)

geo = Geometry([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])
room2d = DFRoom2D(geo=flatten(geo), flr_to_ceiling="3", conditioned=Toggle(True))  # -> report, room2d; plug-in component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

# ----
# /deeprad/data/models/floorplan_test/Building_6_29c00735.hbjson
path = FilePath("C:\Users\Administrator\master\git\deeprad\data\models\floorplan_test\Building_6_29c00735.hbjson")

toggle = BooleanToggle(True)
loadobjects = HBLoadObjects(hb_file=path, load=Toggle(True))  # -> report, hb_objs; plug-in component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
introom2d = DFIntersectRoom2Ds(room2ds=flatten(room2d.room2d), run=toggle)  # -> int_room2ds; plug-in component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
solveadj2d = DFSolveAdjacency(room2ds=flatten(introom2d), run=toggle)  # -> report, adj_room2ds; plug-in component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
vizbytype = HBVisualizeByType(hb_objs=loadobjects.hb_objs)  # -> walls, interior_walls, roofs, ceilings, exterior_floors, interior_floors, air_walls, apertures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; plug-in component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
simpleratiopar = DFSimpleWindowRatioParameters(ratio="0.3")  # -> win_par; plug-in component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
faceattr = HBFaceAttributes({"Display Name": "display_name", "Simulation Name (Identifier)": "identifier", "Boundary Condition": "boundary_condition", "Has Parent": "has_parent", "Parent": "parent", "Area": "area", "Perimeter": "perimeter", "Face Type": "type", "Aperture Is Operable": "is_operable", "Door Is Glass": "is_glass"}, selected="Display Name")
applyfacadepar = DFApplyFacadeParameters(df_obj=flatten(solveadj2d.adj_room2ds), win_par=simpleratiopar)  # -> report, df_obj; plug-in component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
story = DFStory(room2ds=flatten(applyfacadepar.df_obj))  # -> report, story; plug-in component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
data = Data(["Face: Room_f328deae..Face0", "Face: Room_f328deae..Face1", "Face: Room_f328deae..Face2", "Face: Room_f328deae..Face3", "Face: Room_f328deae..Face4", "Aperture: Room_f328deae..Face4_Glz1", "Face: Room_f328deae..Face5", "Face: Room_e2080b13..Face0", "Face: Room_e2080b13..Face1", "Aperture: Room_e2080b13..Face1_Glz1"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])
lablefaces = HBLabelFaces(hb_objs=flatten(loadobjects.hb_objs), attribute=faceattr, sub_faces=Toggle(False))  # -> label_text, base_pts, labels, wire_frame; plug-in component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
python = GhPythonScript(x=data)  # -> face_names, face_vals; inputs x: list
# ---------- python: Python ----------
h = x[:34]
v = x[34:]

assert len(h) == len(v)

face_names = h
face_vals = v
# ---------- end python ----------
buildingstories = DFBuildingFromStories(stories=story.story)  # -> report, building; plug-in component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
panel = Panel(python.face_names)
panel_2 = Panel(python.face_vals)
model = DFModel(buildings=flatten(buildingstories.building))  # -> report, model; plug-in component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
panel_3 = Panel(lablefaces.labels)
tohoneybee = DFModelToHoneybee(model=model.model, run=Toggle(True))  # -> report, hb_models; plug-in component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
toggle_2 = BooleanToggle(True)
vizbytype_2 = HBVisualizeByType(hb_objs=tohoneybee.hb_models)  # -> walls, interior_walls, roofs, ceilings, exterior_floors, interior_floors, air_walls, apertures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; plug-in component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
vizall = HBVizualizeAll(hb_objs=flatten(tohoneybee.hb_models))  # -> geo; plug-in component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
simoutput = HBSimulationOutput(zone_energy_use=toggle_2, gains_and_losses=toggle_2, surface_temperature=toggle_2, surface_energy_flow=toggle_2)  # -> report, sim_output; plug-in component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
simpar = HBSimulationParameter(output=simoutput.sim_output, timestep=6)  # -> sim_par; plug-in component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
panel_4 = Panel("https://www.energyplus.net/weather-download/north_and_central_america_wmo_region_4/USA/MA/USA_MA_Boston-Logan.Intl.AP.725090_TMY3/all")
downloadepw = LBDownloadWeather(weather_URL=panel_4)  # -> epw_file, stat_file, ddy_file; plug-in component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
toggle_3 = BooleanToggle(True)
modeltoosm = HBModelToOSM(model=tohoneybee.hb_models, epw_file=downloadepw.epw_file, sim_par=simpar, write=toggle_3, run=toggle_3)  # -> report, jsons, osw, osm, idf, sql, zsz, rdd, html; plug-in component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
data_2 = Data(tohoneybee.hb_models)
faceresult = HBReadFaceResult(sql=modeltoosm.sql)  # -> face_indoor_temp, face_outdoor_temp, face_energy_flow; plug-in component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
colorfaces = HBColorFaces(data=flatten(faceresult.face_outdoor_temp), hb_objs=flatten(data_2))  # -> report, mesh, wire_frame, legend, title, faces, colors, values; plug-in component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
panel_5 = Panel(colorfaces.faces)
